# Grasshopper definition track tracer gh02.gh (Grasshopper 1.0.7)
# plug-ins: Pufferfish, LunchBox

orange_line_sections = Curve([<curve referenced from the Rhino model> x32])

# ---- group: Stations that are !track !stations, custom input
green_non_uniform = Plane([Plane(origin=(306.0483822, 210.0150647, 0), x=(0, -1, 0), y=(1, 0, 0)), Plane(origin=(305.8991515, 216.735915, 0), x=(-0.00415002016, -0.9999913886, 0), y=(0.9999913886, -0.00415002016, 0)), Plane(origin=(306.0483822, 223.7027936, 0), x=(0, -1, 0), y=(1, 0, 0)), Plane(origin=(317.1912991, 350.0074616, 0), x=(-0.6946481809, -0.7193496401, 0), y=(0.7193496401, -0.6946481809, 0)), Plane(origin=(326.5351454, 359.6979703, 0), x=(-0.6935784846, -0.7203810697, 0), y=(0.7203810697, -0.6935784846, 0)), Plane(origin=(321.6992703, 354.9636503, 0), x=(-0.6946481809, -0.7193496401, 0), y=(0.7193496401, -0.6946481809, 0))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])
orange_non_uniform = Plane([Plane(origin=(143.2557958, 255.1814485, 0), x=(-0.001485966333, 0.999998896, 0), y=(-0.999998896, -0.001485966333, 0)), Plane(origin=(143.519123, 261.8149068, 0), x=(0, 1, 0), y=(-1, 0, 0)), Plane(origin=(143.2469086, 268.6418837, 0), x=(0, 1, 0), y=(-1, 0, 0)), Plane(origin=(270.2374151, 264.7795037, 0), x=(-0.004150020161, -0.9999913886, 0), y=(0.9999913886, -0.004150020161, 0)), Plane(origin=(269.9692329, 258.0492273, 0), x=(0, -1, 0), y=(1, 0, 0)), Plane(origin=(270.1715239, 251.2494893, 0), x=(-0.005635969115, -0.9999841178, 0), y=(0.9999841178, -0.005635969115, 0))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])
blue_non_uniform = Plane([Plane(origin=(236.5325368, 58.22101887, 0), x=(0.5049199423, 0.8631661786, 0), y=(-0.8631661786, 0.5049199423, 0)), Plane(origin=(236.982429, 64.66791221, 0), x=(0, 1, 0), y=(-1, 0, 0)), Plane(origin=(236.7102146, 71.49488909, 0), x=(0, 1, 0), y=(-1, 0, 0)), Plane(origin=(208.6798014, 151.5355933, 0), x=(0, 1, 0), y=(-1, 0, 0)), Plane(origin=(208.9408995, 158.1690517, 0), x=(0, 1, 0), y=(-1, 0, 0)), Plane(origin=(208.6686852, 164.9960285, 0), x=(0, 1, 0), y=(-1, 0, 0))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])
red_non_uniform = Plane([Plane(origin=(256.5672776, 258.0481136, 0), x=(0.999998896, -0.001485966333, 0), y=(0.001485966333, 0.999998896, 0)), PlaneXY(265.0967956, 258.0492273, 0), Plane(origin=(273.6274281, 258.0492281, 0), x=(0.999998896, 0.001485966332, 0), y=(-0.001485966332, 0.999998896, 0)), Plane(origin=(292.5264457, 258.0134908, 0), x=(0.999998896, -0.001485966333, 0), y=(0.001485966333, 0.999998896, 0)), Plane(origin=(301.0851865, 258.0498747, 0), x=(0.9999913886, -0.004150020161, 0), y=(0.004150020161, 0.9999913886, 0)), Plane(origin=(309.5854817, 258.0157198, 0), x=(0.999998896, 0.001485966332, 0), y=(-0.001485966332, 0.999998896, 0))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])
yellow_non_uniform = Plane([Plane(origin=(246.9199644, 58.01217468, 0), x=(0.005635969115, 0.9999841178, 0), y=(-0.9999841178, 0.005635969115, 0)), Plane(origin=(246.6884002, 64.64776567, 0), x=(0, 1, 0), y=(-1, 0, 0)), Plane(origin=(246.9858188, 71.47045448, 0), x=(0.004150020161, 0.9999913886, 0), y=(-0.9999913886, 0.004150020161, 0)), Plane(origin=(218.878435, 151.5133141, 0), x=(0.005635969115, 0.9999841178, 0), y=(-0.9999841178, 0.005635969115, 0)), Plane(origin=(218.6437582, 158.148918, 0), x=(0, 1, 0), y=(-1, 0, 0)), Plane(origin=(220.3383238, 163.5992718, 0), x=(0.6926354354, 0.7212878438, 0), y=(-0.7212878438, 0.6926354354, 0))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])

# ---- group: Yellow Line
numleds = Slider(2.394, range=1.9..10)
numleds_2 = Slider(2.495, range=1.9..10)
numleds_3 = Slider(2.603, range=1.9..10)
numleds_4 = Slider(2.328, range=1.9..10)
numleds_5 = Slider(2.27, range=1.9..10)
numleds_6 = Slider(2.269, range=1.9..10)
numleds_7 = Slider(2.291, range=1.9..10)
numleds_8 = Slider(2.446, range=1.9..10)
numleds_9 = Slider(2.415, range=1.9..10)
numleds_10 = Slider(2.178, range=1.9..10)
numleds_11 = Slider(2.165, range=1.9..10)
numleds_12 = Slider(2.371, range=1.9..10)
numleds_13 = Slider(2.266, range=1.9..10)
numleds_14 = Slider(2.261, range=1.9..10)
numleds_15 = Slider(2.242, range=1.9..10)

# ---- group: Green Line
numleds_16 = Slider(2.151, range=1.9..10)
numleds_17 = Slider(2.298, range=1.9..10)
numleds_18 = Slider(2.3, range=1.9..10)
numleds_19 = Slider(2.368, range=1.9..10)
numleds_20 = Slider(2.328, range=1.9..10)
numleds_21 = Slider(2.222, range=1.9..10)
numleds_22 = Slider(2.269, range=1.9..10)
numleds_23 = Slider(2.172, range=1.9..10)
numleds_24 = Slider(2.38, range=1.9..10)
numleds_25 = Slider(2.095, range=1.9..10)
numleds_26 = Slider(2.172, range=1.9..10)
numleds_27 = Slider(2.15, range=1.9..10)
numleds_28 = Slider(2.328, range=1.9..10)
numleds_29 = Slider(2.141, range=1.9..10)
numleds_30 = Slider(2.312, range=1.9..10)
numleds_31 = Slider(2.291, range=1.9..10)
numleds_32 = Slider(2.317, range=1.9..10)
numleds_33 = Slider(2.415, range=1.9..10)
numleds_34 = Slider(2.221, range=1.9..10)

# ---- group: Collections of Curves describing center of track
orange_line_sections_2 = Curve([<curve referenced from the Rhino model> x26])  # disabled
yellow_line_sections = Curve([<curve referenced from the Rhino model> x15])  # disabled
green_line_sections = Curve([<curve referenced from the Rhino model> x19])  # disabled
blue_line_sections = Curve([<curve referenced from the Rhino model> x27])
red_line_sections = Curve([<curve referenced from the Rhino model> x26])  # disabled

# ---- group: Power Rail Layout Parameters
main_power_rail_trace_width = Slider(1.7, range=0..3)
offset_dist_power_gnd_rail = Slider(2.9, range=0..5)
and_gnd_trace_width = Slider(0.22, range=0..3)
din_dout_trace_width = Slider(0.099, range=0..1)

# ---- group: Blue Line
numleds_35 = Slider(2.55, range=1.9..10)
numleds_36 = Slider(2.371, range=1.9..10)
numleds_37 = Slider(2.719, range=1.9..10)
numleds_38 = Slider(2.5, range=1.9..10)
numleds_39 = Slider(2.433, range=1.9..10)
numleds_40 = Slider(2.366, range=1.9..10)
numleds_41 = Slider(2.385, range=1.9..10)
numleds_42 = Slider(2.438, range=1.9..10)
numleds_43 = Slider(2.405, range=1.9..10)
numleds_44 = Slider(2.284, range=1.9..10)
numleds_45 = Slider(2.357, range=1.9..10)
numleds_46 = Slider(2.586, range=1.9..10)
numleds_47 = Slider(2.519, range=1.9..10)
numleds_48 = Slider(2.43, range=1.9..10)
numleds_49 = Slider(2.617, range=1.9..10)
numleds_50 = Slider(2.454, range=1.9..10)
numleds_51 = Slider(2.422, range=1.9..10)
numleds_52 = Slider(2.422, range=1.9..10)
numleds_53 = Slider(2.232, range=1.9..10)
numleds_54 = Slider(2.259, range=1.9..10)
numleds_55 = Slider(2.232, range=1.9..10)
numleds_56 = Slider(2.261, range=1.9..10)
numleds_57 = Slider(2.242, range=1.9..10)
numleds_58 = Slider(2.235, range=1.9..10)
numleds_59 = Slider(2.227, range=1.9..10)
numleds_60 = Slider(2.446, range=1.9..10)
numleds_61 = Slider(2.493, range=1.9..10)

# ----
orange_line_power = Curve(<curve referenced from the Rhino model>)
yellow_line_power = Curve(<curve referenced from the Rhino model>)
green_line_power = Curve(<curve referenced from the Rhino model>)
blue_line_power = Curve(<curve referenced from the Rhino model>)
red_line_power = Curve(<curve referenced from the Rhino model>)

# ---- group: Orange Line
numleds_62 = Slider(2.335, range=1.9..10)
numleds_63 = Slider(2.338, range=1.9..10)
numleds_64 = Slider(2.632, range=1.9..10)
numleds_65 = Slider(2.487, range=1.9..10)
numleds_66 = Slider(2.484, range=1.9..10)
numleds_67 = Slider(2.399, range=1.9..10)
numleds_68 = Slider(2.361, range=1.9..10)
numleds_69 = Slider(2.398, range=1.9..10)
numleds_70 = Slider(2.405, range=1.9..10)
numleds_71 = Slider(2.32, range=1.9..10)
numleds_72 = Slider(2.371, range=1.9..10)
numleds_73 = Slider(2.232, range=1.9..10)
numleds_74 = Slider(2.267, range=1.9..10)
numleds_75 = Slider(2.046, range=1.9..10)
numleds_76 = Slider(2.268, range=1.9..10)
numleds_77 = Slider(2.145, range=1.9..10)
numleds_78 = Slider(2.235, range=1.9..10)
numleds_79 = Slider(2.284, range=1.9..10)
numleds_80 = Slider(2.429, range=1.9..10)
numleds_81 = Slider(2.235, range=1.9..10)
numleds_82 = Slider(2.165, range=1.9..10)
numleds_83 = Slider(2.217, range=1.9..10)
numleds_84 = Slider(2.435, range=1.9..10)
numleds_85 = Slider(2.195, range=1.9..10)
numleds_86 = Slider(2.04, range=1.9..10)
numleds_87 = Slider(2.01, range=1.9..10)

# ---- group: Red Line Spacing
numleds_88 = Slider(2.165, range=1.587..10)
numleds_89 = Slider(2.069, range=1.9..10)
numleds_90 = Slider(2.055, range=1.587..10)
numleds_91 = Slider(2.055, range=1.587..10)
numleds_92 = Slider(2.17, range=1.587..10)
numleds_93 = Slider(2.031, range=1.587..10)
numleds_94 = Slider(2.008, range=1.587..10)
numleds_95 = Slider(2.37, range=1.587..10)
numleds_96 = Slider(1.972, range=1.587..10)
numleds_97 = Slider(1.972, range=1.587..10)
numleds_98 = Slider(2.575, range=1.9..10)
numleds_99 = Slider(2.396, range=1.8..10)
numleds_100 = Slider(2.714, range=1.587..10)
numleds_101 = Slider(2.241, range=1.587..10)
numleds_102 = Slider(2.031, range=1.587..10)
numleds_103 = Slider(2.202, range=1.587..10)
numleds_104 = Slider(2.235, range=1.587..10)
numleds_105 = Slider(2.283, range=1.587..10)
numleds_106 = Slider(2.471, range=1.587..10)
numleds_107 = Slider(2.22, range=1.587..10)
numleds_108 = Slider(2.189, range=1.9..10)
numleds_109 = Slider(2.149, range=1.587..10)
numleds_110 = Slider(2.183, range=1.587..10)
numleds_111 = Slider(2.246, range=1.587..10)
numleds_112 = Slider(2.274, range=1.587..10)
numleds_113 = Slider(2.244, range=1.587..10)

# ---- group: LED 1515 Definitions
dout_pad_center = Point(Point(78.349277, -8.575843118, 0))
polarity_marking = Curve([<curve referenced from the Rhino model> x2])
gnd_pad_cen = Point(Point(77.399277, -8.575843118, 0))
pwr_pad_cen = Point(Point(78.349277, -9.525843118, 0))
base_plane = Plane(PlaneXY(77.874277, -9.050843118, 0))
top_solder = Curve([<curve referenced from the Rhino model> x4])
courtyard = Curve(<curve referenced from the Rhino model>)
top_layer = Curve([<curve referenced from the Rhino model> x4])

# ---- group: Station Line segments
orange_single_track_stations = Curve([<curve referenced from the Rhino model> x13])
red_single_track_stations = Curve([<curve referenced from the Rhino model> x24])
blue_single_track_stations = Curve([<curve referenced from the Rhino model> x2])
green_single_track_stations = Curve([<curve referenced from the Rhino model> x12])
# Min Distance:
# 1.8 in strait
# 2.0 in curve
yellow_single_track_stations = Curve([<curve referenced from the Rhino model> x2])
path_mapper = PathMapper(orange_single_track_stations, source="{A}", target="{3}")
path_mapper_2 = PathMapper(red_single_track_stations, source="{A}", target="{2}")
path_mapper_3 = PathMapper(blue_single_track_stations, source="{A}", target="{1}")
path_mapper_4 = PathMapper(green_single_track_stations, source="{A}", target="{0}")
path_mapper_5 = PathMapper(yellow_single_track_stations, source="{A}", target="{4}")

# ----
num = Number(10)  # disabled
path_mapper_6 = PathMapper(num, source="{A}", target="{5}")
path_mapper_7 = PathMapper(red_line_sections, source="{A}", target="{0}")
path_mapper_8 = PathMapper(orange_line_sections_2, source="{A}", target="{1}")
path_mapper_9 = PathMapper(blue_line_sections, source="{A}", target="{2}")
path_mapper_10 = PathMapper(yellow_line_sections, source="{A}", target="{4}")
path_mapper_11 = PathMapper(green_line_sections, source="{A}", target="{3}")
relay = Relay([blue_line_power, red_line_power, orange_line_power, yellow_line_power, green_line_power])
power_rail_curve = Curve(relay)
path_mapper_12 = PathMapper(
    [orange_non_uniform, blue_non_uniform, red_non_uniform, green_non_uniform, yellow_non_uniform],
    source="{A}",
    target="{1}")
relay_2 = Relay([numleds, numleds_2, numleds_3, numleds_4, numleds_5, numleds_6, numleds_7, numleds_8, numleds_9, numleds_10, numleds_11, numleds_12, numleds_13, numleds_14, numleds_15])  # disabled
relay_3 = Relay([numleds_53, numleds_54, numleds_55, numleds_56, numleds_57, numleds_58, numleds_59, numleds_60, numleds_35, numleds_61, numleds_36, numleds_37, numleds_38, numleds_39, numleds_40, numleds_41, numleds_42, numleds_43, numleds_44, numleds_45, numleds_46, numleds_47, numleds_48, numleds_49, numleds_50, numleds_51, numleds_52])
relay_4 = Relay([numleds_89, numleds_90, numleds_91, numleds_92, numleds_93, numleds_94, numleds_88, numleds_95, numleds_96, numleds_97, numleds_98, numleds_99, numleds_100, numleds_101, numleds_102, numleds_103, numleds_104, numleds_105, numleds_106, numleds_107, numleds_108, numleds_109, numleds_110, numleds_111, numleds_112, numleds_113])  # disabled
divide = DivideCurve(Curve=[path_mapper, path_mapper_2, path_mapper_3, path_mapper_4, path_mapper_5], Count=2, Kinks=False)  # -> Points, Tangents, Parameters
relay_5 = Relay([numleds_25, numleds_26, numleds_27, numleds_28, numleds_29, numleds_30, numleds_31, numleds_32, numleds_33, numleds_34, numleds_17, numleds_18, numleds_19, numleds_20, numleds_21, numleds_22, numleds_23, numleds_24, numleds_16])  # disabled
lng = ListLength(List=[numleds_73, numleds_74, numleds_75, numleds_76, numleds_77, numleds_78, numleds_79, numleds_80, numleds_62, numleds_81, numleds_63, numleds_64, numleds_65, numleds_66, numleds_67, numleds_68, numleds_69, numleds_70, numleds_71, numleds_72, numleds_82, numleds_83, numleds_84, numleds_85, numleds_86, numleds_87])
path_mapper_13 = PathMapper(relay_2, source="{A}", target="{4}")
path_mapper_14 = PathMapper(relay_4, source="{A}", target="{0}")
num_2 = Number([10, 10, 10, 10])
path_mapper_15 = PathMapper(relay_3, source="{A}", target="{2}")  # disabled
path_mapper_16 = PathMapper(
    [numleds_73, numleds_74, numleds_75, numleds_76, numleds_77, numleds_78, numleds_79, numleds_80, numleds_62, numleds_81, numleds_63, numleds_64, numleds_65, numleds_66, numleds_67, numleds_68, numleds_69, numleds_70, numleds_71, numleds_72, numleds_82, numleds_83, numleds_84, numleds_85, numleds_86, numleds_87],
    source="{A}",
    target="{1}")
path_mapper_17 = PathMapper(relay_5, source="{A}", target="{3}")
shatter = Shatter(Curve=[path_mapper, path_mapper_2, path_mapper_3, path_mapper_4, path_mapper_5], Parameters=flatten(divide.Parameters))
range = Range(Domain=Domain(10, 10), Steps=lng)
relay_6 = Relay([path_mapper_14, path_mapper_16, path_mapper_15, path_mapper_13, path_mapper_17, path_mapper_6])
weave = Weave(
    Pattern=[0, 1],
    Stream0=[numleds_73, numleds_74, numleds_75, numleds_76, numleds_77, numleds_78, numleds_79, numleds_80, numleds_62, numleds_81, numleds_63, numleds_64, numleds_65, numleds_66, numleds_67, numleds_68, numleds_69, numleds_70, numleds_71, numleds_72, numleds_82, numleds_83, numleds_84, numleds_85, numleds_86, numleds_87],
    Stream1=range,
    NullGaps=False)
item = ListItem(List=shatter, Index=1, Wrap=False)  # -> flatten(Item)
end = EndPoints(Curve=item)  # -> Start, End
path_mapper_18 = PathMapper(item, source="{A}", target="{5}")
led_distro_curve = Curve([path_mapper_7, path_mapper_8, path_mapper_9, path_mapper_10, path_mapper_11, path_mapper_18])
short = ShortestList(ListA=led_distro_curve, ListB=relay_6, TrimMode=2)  # -> ListA, ListB
panel = Panel([numleds_73, numleds_74, numleds_75, numleds_76, numleds_77, numleds_78, numleds_79, numleds_80, numleds_62, numleds_81, numleds_63, numleds_64, numleds_65, numleds_66, numleds_67, numleds_68, numleds_69, numleds_70, numleds_71, numleds_72, numleds_82, numleds_83, numleds_84, numleds_85, numleds_86, numleds_87])
panel_2 = Panel(path_mapper_12)
divlength = DivideLength(Curve=led_distro_curve, Length=short.ListB)  # -> Points, Tangents, Parameters
subtraction = Subtraction(A=offset_dist_power_gnd_rail, B=main_power_rail_trace_width)
multiplication = Multiplication(A=subtraction, B=-1)
subtraction_2 = Subtraction(A=short.ListB, B=0.95)
move = Move(Geometry=dout_pad_center, Motion=Vector(0, -0.95, 0))  # -> Geometry, Transform
X = UnitX(Factor=subtraction_2)
Y = UnitY(Factor=multiplication)
xy = XYPlane(Origin=divlength.Points)
Y_2 = UnitY(Factor=subtraction)
move_2 = Move(Geometry=move.Geometry, Motion=X)  # -> Geometry, Transform
align = AlignPlane(Plane=xy, Direction=divlength.Tangents)  # -> Plane, Angle
move_3 = Move(Geometry=pwr_pad_cen, Motion=Y)  # -> Geometry, Transform
move_4 = Move(Geometry=gnd_pad_cen, Motion=Y_2)  # -> Geometry, Transform
lng_2 = ListLength(List=flatten(path_mapper_12))
lng_3 = ListLength(List=flatten(divlength.Points))
lng_4 = ListLength(List=align.Plane)
multiplication_2 = Multiplication(A=din_dout_trace_width, B=-1)
ln = Line(StartPoint=dout_pad_center, EndPoint=move_2.Geometry)
ln_2 = Line(StartPoint=pwr_pad_cen, EndPoint=move_3.Geometry)
ln_3 = Line(StartPoint=gnd_pad_cen, EndPoint=move_4.Geometry)
multiplication_3 = Multiplication(A=and_gnd_trace_width, B=-1)
addition = Addition(A=lng_2, B=lng_3)
len = Length(Curve=led_distro_curve)
multiplication_4 = Multiplication(A=offset_dist_power_gnd_rail, B=-1)
partition = PartitionList(List=led_distro_curve, Size=1)
offcrv = OffsetCurve(Curve=ln, Plane=PlaneXY(0, 0, 0), Distance=din_dout_trace_width, BothSides=multiplication_2, Kinks=0, CapType=1)
line = LineSDL(Start=base_plane, Direction=Vector(13.32435278, 0, 0), Length=len)
offcrv_2 = OffsetCurve(
    Curve=power_rail_curve,
    Plane=PlaneXY(0, 0, 0),
    Distance=offset_dist_power_gnd_rail,
    BothSides=multiplication_4,
    Kinks=0,
    CapType=0)
# Total Number of LEDs
panel_3 = Panel(lng_3)
offcrv_3 = OffsetCurve(Curve=ln_2, Plane=PlaneXY(0, 0, 0), Distance=and_gnd_trace_width, BothSides=multiplication_3, Kinks=0, CapType=1)
offcrv_4 = OffsetCurve(Curve=ln_3, Plane=PlaneXY(0, 0, 0), Distance=and_gnd_trace_width, BothSides=multiplication_3, Kinks=0, CapType=1)
path_mapper_19 = PathMapper(offcrv, source="{?;?}", target="{0}")
multiplication_5 = Multiplication(A=main_power_rail_trace_width, B=-1)
X_2 = UnitX(Factor=short.ListB)
divlength_2 = DivideLength(Curve=line, Length=short.ListB)  # -> Points, Tangents, Parameters
multiplication_6 = Multiplication(A=X_2, B=lng_4)
orient = Orient(Geometry=graft(path_mapper_19), Source=base_plane, Target=divlength_2.Points)  # -> Geometry, Transform
orient_2 = Orient(Geometry=offcrv_4, Source=base_plane, Target=divlength_2.Points)  # -> Geometry, Transform
orient_3 = Orient(Geometry=offcrv_3, Source=base_plane, Target=divlength_2.Points)  # -> Geometry, Transform
line_2 = LineSDL(Start=base_plane, Direction=multiplication_6, Length=multiplication_6)
group = Group(Objects=polarity_marking)
group_2 = Group(Objects=courtyard)
group_3 = Group(Objects=top_layer)
group_4 = Group(Objects=top_solder)
lng_5 = ListLength(List=orient.Geometry)
split = SplitList(List=orient.Geometry, Index=expr("x-1", lng_5))  # -> ListA, ListB
orient_4 = Orient(Geometry=group_2, Source=base_plane, Target=[align.Plane, path_mapper_12])  # -> Geometry, Transform
orient_5 = Orient(Geometry=group_3, Source=base_plane, Target=[align.Plane, path_mapper_12])  # -> Geometry, Transform
orient_6 = Orient(Geometry=group_4, Source=base_plane, Target=[align.Plane, path_mapper_12])  # -> Geometry, Transform

# ---- group: No Flowed intermediate lines
orient_7 = Orient(Geometry=offcrv, Source=base_plane, Target=align.Plane)  # -> Geometry, Transform

# ----
offcrv_5 = OffsetCurve(
    Curve=offcrv_2,
    Plane=PlaneXY(0, 0, 0),
    Distance=main_power_rail_trace_width,
    BothSides=multiplication_5,
    Kinks=0,
    CapType=1)
flow = Flow(Geometry=split.ListA, Base=line_2, Target=partition, ReverseBase=False, ReverseTarget=False, Stretch=False, Rigid=True)
flow_2 = Flow(
    Geometry=[orient_3.Geometry, orient_2.Geometry],
    Base=line_2,
    Target=partition,
    ReverseBase=False,
    ReverseTarget=False,
    Stretch=False,
    Rigid=True)

# ---- group: Either/Or / All LED Courtyards
ungroup = Ungroup(Group=orient_4.Geometry)

# ---- group: Either/Or / Add Baked Courtyard rectangles to be PnP'd here, if doing partial
crv = Curve([<curve referenced from the Rhino model> x1140])

# ----
lng_6 = ListLength(List=orient_5.Geometry)
item_2 = ListItem(List=orient_5.Geometry, Index=lng_6, Wrap=True)
item_3 = ListItem(List=flow, Index=Slider(5, range=0..23), Wrap=False)
drec = DeconstuctRectangle(Rectangle=crv)  # -> BasePlane, XInterval, YInterval
orient_8 = Orient(Geometry=group, Source=base_plane, Target=drec.BasePlane)  # -> Geometry, Transform
relay_7 = Relay([align.Plane, path_mapper_12])
panel_4 = Panel(item_2)

# ---- group: Change Feed Alignment in "D"
align_2 = AlignPlane(Plane=drec.BasePlane, Direction=Vector(0, -16.00976074, 0))  # -> Plane, Angle

# ---- group: Board Origin for PnP
pt = Point(Point(215.3639084, 171.9487591, 0))

# ---- group: Bake This
geo = Geometry([flow, flow_2, orient_6.Geometry, orient_5.Geometry, orient_4.Geometry, orient_8.Geometry])

# ----
deg = Degrees(Radians=align_2.Angle)
panel_5 = Panel(deg)

# ---- group: Baked Numbering
baked_blue_line_in_sequence = Curve([<curve referenced from the Rhino model> x298])
baked_red_line_in_sequence = Curve([<curve referenced from the Rhino model> x267])
baked_orange_in_sequence = Curve([<curve referenced from the Rhino model> x209])
baked_yellow_in_sequence = Curve([<curve referenced from the Rhino model> x185])
baked_green_in_sequence = Curve([<curve referenced from the Rhino model> x181])
lng_7 = ListLength(List=baked_red_line_in_sequence)
addition_2 = Addition(A=lng_7, B=1)
pcen = PolygonCenter(Polyline=baked_red_line_in_sequence)  # -> CenterV, CenterE, CenterA
series = Series(Start=0, Step=1, Count=lng_7)
move_5 = Move(Geometry=pcen.CenterV, Motion=Vector(0, -0.6340440037, 0))  # -> Geometry, Transform
txt = Text("RD")
dup = DuplicateData(Data=txt, Number=lng_7, Order=True)
concat = Concatenate(FragmentA=dup, FragmentB=series)
tag = TextTag3D(Location=move_5.Geometry, Text=concat, Size=0.4, Justification=8)

# ---- group: Translate PnP Coords to Relative
vec2pt = Vector2Pt(PointA=pt, PointB=drec.BasePlane, Unitize=False)  # -> Vector, Length
rep = ReplaceText(Text=vec2pt.Vector, Find="{", RecursiveReplace=False)
rep_2 = ReplaceText(Text=rep, Find="}", RecursiveReplace=False)
split_2 = TextSplit(Text=rep_2, Separators=",")
split_3 = SplitList(List=split_2, Index=2)  # -> ListA, ListB
split_4 = SplitList(List=split_3.ListA, Index=1)  # -> flatten(ListA), flatten(ListB)

# ----
roundd = RoundToDecimalPlace(NumberX=deg, DecimalPlace=1, RoundType=1)  # -> flatten(Rounded), Difference

# ---- group: If rotation < 0 Flip to being positive
smaller = SmallerThan(FirstNumber=roundd.Rounded, SecondNumber=0)  # -> SmallerThan, OrEqualTo
dispatch = Dispatch(List=roundd.Rounded, DispatchPattern=smaller.SmallerThan)  # -> ListA, ListB
addition_3 = Addition(A=dispatch.ListA, B=360)
weave_2 = Weave(Pattern=smaller.SmallerThan, Stream0=dispatch.ListB, Stream1=addition_3, NullGaps=False)

# ----
number_slider = Slider(519, range=0..1000)
panel_6 = Panel(weave_2)

# ---- group: Create Numbered List
lng_8 = ListLength(List=weave_2)
series_2 = Series(Start=1, Step=1, Count=lng_8)
concat_2 = Concatenate(FragmentA="LED", FragmentB=series_2)

# ----
footprint_name = Text("SK6805-1515")
layer_name = Text("Front")
comment = Text("SK6805-1515 LED")
roundd_2 = RoundToDecimalPlace(NumberX=split_4.ListA, DecimalPlace=3, RoundType=0)  # -> Rounded, Difference
roundd_3 = RoundToDecimalPlace(NumberX=split_4.ListB, DecimalPlace=3, RoundType=0)  # -> Rounded, Difference
dup_2 = DuplicateData(Data=footprint_name, Number=lng_8, Order=True)
item_4 = ListItem(List=drec.BasePlane, Index=number_slider, Wrap=True)
dup_3 = DuplicateData(Data=layer_name, Number=lng_8, Order=True)
dup_4 = DuplicateData(Data=comment, Number=lng_8, Order=True)
item_5 = ListItem(List=concat_2, Index=number_slider, Wrap=True)
xy_2 = XYPlane(Origin=drec.BasePlane)

# ---- group: Add Rotation text info to each LED
move_6 = Move(Geometry=xy_2, Motion=Vector(0, -0.9537179846, 0))  # -> Geometry, Transform
tag_2 = TextTag3D(Location=flatten(move_6.Geometry), Text=flatten(weave_2), Size=0.4, Justification=5)

# ----
path_mapper_20 = PathMapper(concat_2, source="{A;B}", target="{0}")
path_mapper_21 = PathMapper(dup_2, source="{A;B}", target="{1}")
path_mapper_22 = PathMapper(roundd_2.Rounded, source="{A}", target="{2}")
path_mapper_23 = PathMapper(roundd_3.Rounded, source="{A}", target="{3}")
path_mapper_24 = PathMapper(dup_3, source="{A;B}", target="{4}")
path_mapper_25 = PathMapper(weave_2, source="{A}", target="{5}")
path_mapper_26 = PathMapper(dup_4, source="{A;B}", target="{6}")
panel_7 = Panel("Designator")
panel_8 = Panel("Mid X")
panel_9 = Panel("Mid Y")
panel_10 = Panel("Layer")
panel_11 = Panel("Comment")
panel_12 = Panel("Package")
panel_13 = Panel("Rotation")

# ---- group: Bake to add labels to Dwgs.User
tag_3 = TextTag3D(Location=flatten(xy_2), Text=flatten(concat_2), Size=0.4, Justification=5)

# ----
headings = Text(["Designator", "Package", "Mid X", "Mid Y", "Layer", "Rotation", "Comment"])
csv = CreateCSV(
    DataGridHeaders=headings,
    ValueTree=[path_mapper_20, path_mapper_21, path_mapper_22, path_mapper_23, path_mapper_24, path_mapper_25, path_mapper_26],
    Delimiter=",")
panel_14 = Panel(csv)
