# Grasshopper definition track tracer gh04-dev.gh (Grasshopper 1.0.8)
# plug-ins: Pufferfish, LunchBox, GraphicPlus

orange_line_sections = Curve([<curve referenced from the Rhino model> x32])

# ---- group: Stations that are !track !stations, custom input
green_non_uniform = Plane([Plane(origin=(306.0483822, 210.0150647, 0), x=(0, -1, 0), y=(1, 0, 0)), Plane(origin=(305.8991515, 216.735915, 0), x=(-0.00415002016, -0.9999913886, 0), y=(0.9999913886, -0.00415002016, 0)), Plane(origin=(306.0483822, 223.7027936, 0), x=(0, -1, 0), y=(1, 0, 0)), Plane(origin=(317.1912991, 350.0074616, 0), x=(-0.6946481809, -0.7193496401, 0), y=(0.7193496401, -0.6946481809, 0)), Plane(origin=(326.5351454, 359.6979703, 0), x=(-0.6935784846, -0.7203810697, 0), y=(0.7203810697, -0.6935784846, 0)), Plane(origin=(321.6992703, 354.9636503, 0), x=(-0.6946481809, -0.7193496401, 0), y=(0.7193496401, -0.6946481809, 0))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])
orange_non_uniform = Plane([Plane(origin=(143.2557958, 255.1814485, 0), x=(-0.001485966333, 0.999998896, 0), y=(-0.999998896, -0.001485966333, 0)), Plane(origin=(143.519123, 261.8149068, 0), x=(0, 1, 0), y=(-1, 0, 0)), Plane(origin=(143.2469086, 268.6418837, 0), x=(0, 1, 0), y=(-1, 0, 0)), Plane(origin=(270.2374151, 264.7795037, 0), x=(-0.004150020161, -0.9999913886, 0), y=(0.9999913886, -0.004150020161, 0)), Plane(origin=(269.9692329, 258.0492273, 0), x=(0, -1, 0), y=(1, 0, 0)), Plane(origin=(270.1715239, 251.2494893, 0), x=(-0.005635969115, -0.9999841178, 0), y=(0.9999841178, -0.005635969115, 0))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])
blue_non_uniform = Plane([Plane(origin=(236.5325368, 58.22101887, 0), x=(0.5049199423, 0.8631661786, 0), y=(-0.8631661786, 0.5049199423, 0)), Plane(origin=(236.982429, 64.66791221, 0), x=(0, 1, 0), y=(-1, 0, 0)), Plane(origin=(236.7102146, 71.49488909, 0), x=(0, 1, 0), y=(-1, 0, 0)), Plane(origin=(208.6798014, 151.5355933, 0), x=(0, 1, 0), y=(-1, 0, 0)), Plane(origin=(208.9408995, 158.1690517, 0), x=(0, 1, 0), y=(-1, 0, 0)), Plane(origin=(208.6686852, 164.9960285, 0), x=(0, 1, 0), y=(-1, 0, 0))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])
red_non_uniform = Plane([Plane(origin=(256.5672776, 258.0481136, 0), x=(0.999998896, -0.001485966333, 0), y=(0.001485966333, 0.999998896, 0)), PlaneXY(265.0967956, 258.0492273, 0), Plane(origin=(273.6274281, 258.0492281, 0), x=(0.999998896, 0.001485966332, 0), y=(-0.001485966332, 0.999998896, 0)), Plane(origin=(292.5264457, 258.0134908, 0), x=(0.999998896, -0.001485966333, 0), y=(0.001485966333, 0.999998896, 0)), Plane(origin=(301.0851865, 258.0498747, 0), x=(0.9999913886, -0.004150020161, 0), y=(0.004150020161, 0.9999913886, 0)), Plane(origin=(309.5854817, 258.0157198, 0), x=(0.999998896, 0.001485966332, 0), y=(-0.001485966332, 0.999998896, 0))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])
yellow_non_uniform = Plane([Plane(origin=(246.9199644, 58.01217468, 0), x=(0.005635969115, 0.9999841178, 0), y=(-0.9999841178, 0.005635969115, 0)), Plane(origin=(246.6884002, 64.64776567, 0), x=(0, 1, 0), y=(-1, 0, 0)), Plane(origin=(246.9858188, 71.47045448, 0), x=(0.004150020161, 0.9999913886, 0), y=(-0.9999913886, 0.004150020161, 0)), Plane(origin=(218.878435, 151.5133141, 0), x=(0.005635969115, 0.9999841178, 0), y=(-0.9999841178, 0.005635969115, 0)), Plane(origin=(218.6437582, 158.148918, 0), x=(0, 1, 0), y=(-1, 0, 0)), Plane(origin=(220.3383238, 163.5992718, 0), x=(0.6926354354, 0.7212878438, 0), y=(-0.7212878438, 0.6926354354, 0))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])

# ---- group: Yellow Line
numleds = Slider(1.358, range=1..3)
numleds_2 = Slider(1.33, range=1..3)
numleds_3 = Slider(1.302, range=1..3)
numleds_4 = Slider(1.344, range=1..3)
numleds_5 = Slider(1.334, range=1..3)
numleds_6 = Slider(1.412, range=1..3)
numleds_7 = Slider(1.368, range=1..3)
numleds_8 = Slider(1.365, range=1..3)
numleds_9 = Slider(1.389, range=1..3)
numleds_10 = Slider(1.358, range=1..3)
numleds_11 = Slider(1.389, range=1..3)
numleds_12 = Slider(1.399, range=1..3)
numleds_13 = Slider(1.422, range=1..3)
numleds_14 = Slider(1.441, range=1..3)
numleds_15 = Slider(1.437, range=1..3)

# ---- group: Green Line
numleds_16 = Slider(1.424, range=1..3)
numleds_17 = Slider(1.406, range=1..3)
numleds_18 = Slider(1.409, range=1..3)
numleds_19 = Slider(1.423, range=1..3)
numleds_20 = Slider(1.456, range=1..3)
numleds_21 = Slider(1.435, range=1..3)
numleds_22 = Slider(1.464, range=1..3)
numleds_23 = Slider(1.333, range=1..3)
numleds_24 = Slider(1.394, range=1..3)
numleds_25 = Slider(1.458, range=1..3)
numleds_26 = Slider(1.438, range=1..3)
numleds_27 = Slider(1.448, range=1..3)
numleds_28 = Slider(1.47, range=1..3)
numleds_29 = Slider(1.398, range=1..3)
numleds_30 = Slider(1.411, range=1..3)
numleds_31 = Slider(1.481, range=1..3)
numleds_32 = Slider(1.405, range=1..3)
numleds_33 = Slider(1.386, range=1..3)
numleds_34 = Slider(1.38, range=1..3)

# ---- group: Collections of Curves describing center of track
orange_line_sections_2 = Curve([<curve referenced from the Rhino model> x26])
yellow_line_sections = Curve([<curve referenced from the Rhino model> x15])
green_line_sections = Curve([<curve referenced from the Rhino model> x19])
blue_line_sections = Curve([<curve referenced from the Rhino model> x27])
red_line_sections = Curve([<curve referenced from the Rhino model> x26])

# ---- group: Power Rail Layout Parameters
main_power_rail_trace_width = Slider(1.993, range=0..3)
offset_dist_power_gnd_rail = Slider(2.766, range=0..5)
and_gnd_trace_width = Slider(0.15, range=0..3)
din_dout_trace_width = Slider(0.087, range=0..1)

# ---- group: Blue Line
numleds_35 = Slider(1.446, range=1..3)
numleds_36 = Slider(1.499, range=1..3)
numleds_37 = Slider(1.478, range=1..3)
numleds_38 = Slider(1.357, range=1..3)
numleds_39 = Slider(1.486, range=1..3)
numleds_40 = Slider(1.426, range=1..3)
numleds_41 = Slider(1.523, range=1..3)
numleds_42 = Slider(1.494, range=1..3)
numleds_43 = Slider(1.618, range=1..3)
numleds_44 = Slider(1.592, range=1..3)
numleds_45 = Slider(1.537, range=1..3)
numleds_46 = Slider(1.57, range=1..3)
numleds_47 = Slider(1.523, range=1..3)
numleds_48 = Slider(1.521, range=1..3)
numleds_49 = Slider(1.496, range=1..3)
numleds_50 = Slider(1.527, range=1..3)
numleds_51 = Slider(1.535, range=1..3)
numleds_52 = Slider(1.442, range=1..3)
numleds_53 = Slider(1.46, range=1.2..3)
numleds_54 = Slider(1.34, range=1..3)
numleds_55 = Slider(1.363, range=1..3)
numleds_56 = Slider(1.411, range=1..3)
numleds_57 = Slider(1.431, range=1..3)
numleds_58 = Slider(1.399, range=1..3)
numleds_59 = Slider(1.375, range=1..3)
numleds_60 = Slider(1.417, range=1..3)
numleds_61 = Slider(1.464, range=1..3)

# ----
orange_line_power = Curve(<curve referenced from the Rhino model>)
yellow_line_power = Curve(<curve referenced from the Rhino model>)
green_line_power = Curve(<curve referenced from the Rhino model>)
blue_line_power = Curve(<curve referenced from the Rhino model>)
red_line_power = Curve(<curve referenced from the Rhino model>)

# ---- group: Orange Line
numleds_62 = Slider(1.401, range=1..3)
numleds_63 = Slider(1.378, range=1..3)
numleds_64 = Slider(1.321, range=1..3)
numleds_65 = Slider(1.377, range=1..3)
numleds_66 = Slider(1.416, range=1..3)
numleds_67 = Slider(1.458, range=1..3)
numleds_68 = Slider(1.45, range=1..3)
numleds_69 = Slider(1.391, range=1..3)
numleds_70 = Slider(1.426, range=1..3)
numleds_71 = Slider(1.425, range=1..3)
numleds_72 = Slider(1.376, range=1..3)
numleds_73 = Slider(1.37, range=1..3)
numleds_74 = Slider(1.38, range=1..3)
numleds_75 = Slider(1.369, range=1..3)
numleds_76 = Slider(1.351, range=1..3)
numleds_77 = Slider(1.372, range=1..3)
numleds_78 = Slider(1.355, range=1..3)
numleds_79 = Slider(1.349, range=1..3)
numleds_80 = Slider(1.403, range=1..3)
numleds_81 = Slider(1.394, range=1..3)
numleds_82 = Slider(1.34, range=1..3)
numleds_83 = Slider(1.396, range=1..3)
numleds_84 = Slider(1.425, range=1..3)
numleds_85 = Slider(1.361, range=1..3)
numleds_86 = Slider(1.41, range=1..3)
numleds_87 = Slider(1.399, range=1..3)

# ---- group: Red Line Spacing
numleds_88 = Slider(1.339, range=1..3)
numleds_89 = Slider(1.245, range=1..3)
numleds_90 = Slider(1.244, range=1..3)
numleds_91 = Slider(1.244, range=1..3)
numleds_92 = Slider(1.231, range=1..3)
numleds_93 = Slider(1.285, range=1..3)
numleds_94 = Slider(1.31, range=1..3)
numleds_95 = Slider(1.383, range=1..3)
numleds_96 = Slider(1.342, range=1..3)
numleds_97 = Slider(1.487, range=1..3)
numleds_98 = Slider(1.355, range=1..3)
numleds_99 = Slider(1.674, range=1..3)
numleds_100 = Slider(1.499, range=1..3)
numleds_101 = Slider(1.387, range=1..3)
numleds_102 = Slider(1.451, range=1..3)
numleds_103 = Slider(1.538, range=1..3)
numleds_104 = Slider(1.411, range=1..3)
numleds_105 = Slider(1.336, range=1..3)
numleds_106 = Slider(1.487, range=1..3)
numleds_107 = Slider(1.417, range=1..3)
numleds_108 = Slider(1.33, range=1..3)
numleds_109 = Slider(1.363, range=1..3)
numleds_110 = Slider(1.404, range=1..3)
numleds_111 = Slider(1.398, range=1..3)
numleds_112 = Slider(1.414, range=1..3)
numleds_113 = Slider(1.393, range=1..3)

# ---- group: LED Definitions
dout_pad_center = Point(Point(77.939277, -8.985843118, 0))
gnd_pad_cen = Point(Point(77.309277, -8.985843118, 0))
front_copper = Curve([<curve referenced from the Rhino model> x4])
pwr_pad_cen = Point(Point(77.939277, -9.615843118, 0))
front_paste = Curve([<curve referenced from the Rhino model> x4])
base_plane = Plane(PlaneXY(77.624277, -9.300843118, 0))
courtyard = Curve(<curve referenced from the Rhino model>)
din_center = Point(Point(77.309277, -9.615843118, 0))
front_silks = Curve([<curve referenced from the Rhino model> x2])

# ---- group: Station Line segments
orange_single_track_stations = Curve([<curve referenced from the Rhino model> x13])
red_single_track_stations = Curve([<curve referenced from the Rhino model> x24])
blue_single_track_stations = Curve([<curve referenced from the Rhino model> x8])
green_single_track_stations = Curve([<curve referenced from the Rhino model> x12])
# Min Distance:
# 1.8 in strait
# 2.0 in curve
yellow_single_track_stations = Curve([<curve referenced from the Rhino model> x2])
path_mapper = PathMapper(orange_single_track_stations, source="{A}", target="{1}")
path_mapper_2 = PathMapper(red_single_track_stations, source="{A}", target="{0}")
path_mapper_3 = PathMapper(blue_single_track_stations, source="{A}", target="{2}")
path_mapper_4 = PathMapper(green_single_track_stations, source="{A}", target="{3}")
path_mapper_5 = PathMapper(yellow_single_track_stations, source="{A}", target="{4}")

# ----
num = Number(10)  # disabled
path_mapper_6 = PathMapper(num, source="{A}", target="{1}")
path_mapper_7 = PathMapper(red_line_sections, source="{A}", target="{0}")
path_mapper_8 = PathMapper(orange_line_sections_2, source="{A}", target="{1}")
path_mapper_9 = PathMapper(blue_line_sections, source="{A}", target="{2}")
path_mapper_10 = PathMapper(yellow_line_sections, source="{A}", target="{4}")
path_mapper_11 = PathMapper(green_line_sections, source="{A}", target="{3}")
relay = Relay([blue_line_power, red_line_power, orange_line_power, yellow_line_power, green_line_power])
power_rail_curve = Curve(relay)
path_mapper_12 = PathMapper(blue_non_uniform, source="{A}", target="{2}")
path_mapper_13 = PathMapper(green_non_uniform, source="{A}", target="{3}")
path_mapper_14 = PathMapper(orange_non_uniform, source="{A}", target="{1}")
path_mapper_15 = PathMapper(yellow_non_uniform, source="{A}", target="{4}")
path_mapper_16 = PathMapper(red_non_uniform, source="{A}", target="{0}")
relay_2 = Relay([numleds, numleds_2, numleds_3, numleds_4, numleds_5, numleds_6, numleds_7, numleds_8, numleds_9, numleds_10, numleds_11, numleds_12, numleds_13, numleds_14, numleds_15])
relay_3 = Relay([numleds_53, numleds_54, numleds_55, numleds_56, numleds_57, numleds_58, numleds_59, numleds_60, numleds_35, numleds_61, numleds_36, numleds_37, numleds_38, numleds_39, numleds_40, numleds_41, numleds_42, numleds_43, numleds_44, numleds_45, numleds_46, numleds_47, numleds_48, numleds_49, numleds_50, numleds_51, numleds_52])
relay_4 = Relay([numleds_25, numleds_26, numleds_27, numleds_28, numleds_29, numleds_30, numleds_31, numleds_32, numleds_33, numleds_34, numleds_17, numleds_18, numleds_19, numleds_20, numleds_21, numleds_22, numleds_23, numleds_24, numleds_16])

# ---- group: Enable/Disable these per line
relay_5 = Relay([numleds_73, numleds_74, numleds_75, numleds_76, numleds_77, numleds_78, numleds_79, numleds_80, numleds_62, numleds_81, numleds_63, numleds_64, numleds_65, numleds_66, numleds_67, numleds_68, numleds_69, numleds_70, numleds_71, numleds_72, numleds_82, numleds_83, numleds_84, numleds_85, numleds_86, numleds_87])
relay_6 = Relay([numleds_89, numleds_90, numleds_91, numleds_92, numleds_93, numleds_94, numleds_88, numleds_95, numleds_96, numleds_97, numleds_98, numleds_99, numleds_100, numleds_101, numleds_102, numleds_103, numleds_104, numleds_105, numleds_106, numleds_107, numleds_108, numleds_109, numleds_110, numleds_111, numleds_112, numleds_113])

# ----
path_mapper_17 = PathMapper(relay_2, source="{A}", target="{4}")
relay_7 = Relay([path_mapper_16, path_mapper_14, path_mapper_12, path_mapper_13, path_mapper_15])
path_mapper_18 = PathMapper(relay_3, source="{A}", target="{2}")

# ---- group: This governs the spacing of the In-station LEDs
divide = DivideCurve(Curve=[path_mapper, path_mapper_2, path_mapper_3, path_mapper_4, path_mapper_5], Count=2, Kinks=False)  # -> Points, Tangents, Parameters
shatter = Shatter(Curve=[path_mapper, path_mapper_2, path_mapper_3, path_mapper_4, path_mapper_5], Parameters=flatten(divide.Parameters))

# ----
path_mapper_19 = PathMapper(relay_4, source="{A}", target="{3}")
path_mapper_20 = PathMapper(relay_5, source="{A}", target="{1}")
led_distro_curve = Curve([path_mapper_7, path_mapper_8, path_mapper_9, path_mapper_10, path_mapper_11])
path_mapper_21 = PathMapper(relay_6, source="{A}", target="{0}")
relay_8 = Relay([path_mapper_21, path_mapper_20, path_mapper_18, path_mapper_17, path_mapper_19, path_mapper_6])
align = AlignPlane(Plane=divide.Points, Direction=divide.Tangents)  # -> Plane, Angle
short = ShortestList(ListA=led_distro_curve, ListB=relay_8, TrimMode=2)  # -> ListA, ListB
panel = Panel(shatter)
panel_2 = Panel(relay_7)
divlength = DivideLength(Curve=led_distro_curve, Length=short.ListB)  # -> Points, Tangents, Parameters
xy = XYPlane(Origin=divlength.Points)
align_2 = AlignPlane(Plane=xy, Direction=divlength.Tangents)  # -> Plane, Angle
lng = ListLength(List=flatten(relay_7))
lng_2 = ListLength(List=flatten(divlength.Points))
subtraction = Subtraction(A=offset_dist_power_gnd_rail, B=main_power_rail_trace_width)
multiplication = Multiplication(A=subtraction, B=-1)
lng_3 = ListLength(List=align_2.Plane)
multiplication_2 = Multiplication(A=din_dout_trace_width, B=-1)
addition = Addition(A=lng, B=lng_2)
len = Length(Curve=led_distro_curve)

# ---- group: Power Rail Offestting
multiplication_3 = Multiplication(A=offset_dist_power_gnd_rail, B=-1)
offcrv = OffsetCurve(
    Curve=power_rail_curve,
    Plane=PlaneXY(0, 0, 0),
    Distance=offset_dist_power_gnd_rail,
    BothSides=multiplication_3,
    Kinks=0,
    CapType=0)
multiplication_4 = Multiplication(A=main_power_rail_trace_width, B=-1)
offcrv_2 = OffsetCurve(
    Curve=offcrv,
    Plane=PlaneXY(0, 0, 0),
    Distance=main_power_rail_trace_width,
    BothSides=multiplication_4,
    Kinks=0,
    CapType=1)

# ----
Y = UnitY(Factor=multiplication)
Y_2 = UnitY(Factor=subtraction)
partition = PartitionList(List=led_distro_curve, Size=1)
line = LineSDL(Start=base_plane, Direction=Vector(13.32435278, 0, 0), Length=len)
# Total Number of LEDs
panel_3 = Panel(lng_2)
move = Move(Geometry=pwr_pad_cen, Motion=Y)  # -> Geometry, Transform
move_2 = Move(Geometry=gnd_pad_cen, Motion=Y_2)  # -> Geometry, Transform
X = UnitX(Factor=short.ListB)
ln = Line(StartPoint=pwr_pad_cen, EndPoint=move.Geometry)
divlength_2 = DivideLength(Curve=line, Length=short.ListB)  # -> Points, Tangents, Parameters
ln_2 = Line(StartPoint=gnd_pad_cen, EndPoint=move_2.Geometry)
multiplication_5 = Multiplication(A=and_gnd_trace_width, B=-1)
multiplication_6 = Multiplication(A=X, B=lng_3)

# ---- group: Add !Uniform stations to laydown
relay_9 = Relay([relay_7, align.Plane])

# ----
offcrv_3 = OffsetCurve(Curve=ln, Plane=PlaneXY(0, 0, 0), Distance=and_gnd_trace_width, BothSides=multiplication_5, Kinks=0, CapType=1)
orient = Orient(Geometry=offcrv_3, Source=base_plane, Target=divlength_2.Points)  # -> Geometry, Transform
offcrv_4 = OffsetCurve(Curve=ln_2, Plane=PlaneXY(0, 0, 0), Distance=and_gnd_trace_width, BothSides=multiplication_5, Kinks=0, CapType=1)
orient_2 = Orient(Geometry=offcrv_4, Source=base_plane, Target=divlength_2.Points)  # -> Geometry, Transform
line_2 = LineSDL(Start=base_plane, Direction=multiplication_6, Length=multiplication_6)
river_knockout_srfs = Surface([<surface referenced from the Rhino model> x14])

# ---- group: No Flowed intermediate lines
orient_3 = Orient(Source=base_plane, Target=align_2.Plane)  # -> Geometry, Transform

# ----
group = Group(Geometry=din_center)
river_knockout_srf = Surface([<surface referenced from the Rhino model> x14])
group_2 = Group(Objects=front_silks)
group_3 = Group(Objects=courtyard)
group_4 = Group(Objects=front_copper)
group_5 = Group(Objects=front_paste)
hatch = Hatch([<hatch referenced from the Rhino model> x759])
explode = ExplodeObject(Object=hatch, Recursive=False)
orient_4 = Orient(Geometry=dout_pad_center, Source=base_plane, Target=align_2.Plane)  # -> Geometry, Transform
orient_5 = Orient(Geometry=group_2, Source=base_plane, Target=align_2.Plane)  # -> Geometry, Transform
ungroup = Ungroup(Group=orient_5.Geometry)
orientation_silks = Curve(ungroup)
solid = SolidFill(ShapeGeometry=orientation_silks, Color=RGB(0, 0, 0))
orient_6 = Orient(Geometry=group_3, Source=base_plane, Target=[align_2.Plane, relay_9])  # -> Geometry, Transform
orient_7 = Orient(Geometry=group_4, Source=base_plane, Target=[align_2.Plane, relay_9])  # -> Geometry, Transform
orient_8 = Orient(Geometry=group_5, Source=base_plane, Target=[align_2.Plane, relay_9])  # -> Geometry, Transform
orient_9 = Orient(Geometry=din_center, Source=base_plane, Target=align_2.Plane)  # -> Geometry, Transform
crv = Curve([<curve referenced from the Rhino model> x3911])
ungroup_2 = Ungroup(Group=orient_9.Geometry)
item = ListItem(Index=Slider(5, range=0..23), Wrap=False)
shift = ShiftList(List=orient_9.Geometry, Shift=1, Wrap=False)
flow = Flow(
    Geometry=[orient.Geometry, orient_2.Geometry],
    Base=line_2,
    Target=partition,
    ReverseBase=False,
    ReverseTarget=False,
    Stretch=False,
    Rigid=True)
ln_3 = Line(StartPoint=shift, EndPoint=orient_4.Geometry)
lng_4 = ListLength(List=orient_7.Geometry)

# ---- group: Either/Or / All LED Courtyards
ungroup_3 = Ungroup(Group=orient_6.Geometry)

# ---- group: Either/Or / Add Baked Courtyard rectangles to be PnP'd here, if doing partial
crv_2 = Curve([<curve referenced from the Rhino model> x1140])

# ----
end = EndPoints(Curve=crv)  # -> Start, End
runion = RegionUnion(Curves=crv)
rev = ReverseList(List=ln_3)
static_power_traces = Geometry([<curve referenced from the Rhino model> x44])
item_2 = ListItem(List=orient_7.Geometry, Index=lng_4, Wrap=True)
ccx = CurveCurve(CurveA=crv, CurveB=crv)  # -> Points, ParamsA, ParamsB
merge = Merge(Data1=runion, Data2=crv)
drec = DeconstuctRectangle(Rectangle=ungroup_3)  # -> BasePlane, XInterval, YInterval
split = SplitList(List=rev, Index=1)  # -> ListA, ListB
relay_10 = Relay([align_2.Plane, relay_7])
ungroup_4 = Ungroup(Group=orient_7.Geometry)
incurve = PointInCurve(Point=[end.Start, end.End], Curve=merge)  # -> Relationship, Point
item_3 = ListItem(List=split.ListB, Index=Slider(9, range=0..100), Wrap=True)

# ---- group: Change Feed Alignment in "D"
align_3 = AlignPlane(Plane=drec.BasePlane, Direction=Vector(0, -16.00976074, 0))  # -> Plane, Angle

# ----
offcrv_5 = OffsetCurve(Curve=split.ListB, Plane=PlaneXY(0, 0, 0), Distance=din_dout_trace_width, BothSides=multiplication_2, Kinks=0, CapType=1)
runion_2 = RegionUnion(Curves=flatten([ungroup_4, offcrv_5, flow, static_power_traces]))

# ---- group: Board Origin for PnP
pt = Point(Point(215.3639084, 171.9487591, 0))

# ----
panel_4 = Panel(ccx.Points)
larger = LargerThan(FirstNumber=incurve.Relationship, SecondNumber=1)  # -> LargerThan, OrEqualTo
dispatch = Dispatch(List=crv, DispatchPattern=flatten(larger.LargerThan))  # -> ListA, ListB

# ---- group: Bake These
f_courtyard = Geometry(orient_6.Geometry)
geometry = Geometry(runion_2)
f_silks = Geometry(orient_5.Geometry)
f_mask = Geometry(orient_8.Geometry)

# ----
geo = Geometry([orient_8.Geometry, orient_6.Geometry, orient_5.Geometry])
panel_5 = Panel(item_3)
crv_3 = Curve(dispatch.ListA)
deg = Degrees(Radians=align_3.Angle)
panel_6 = Panel(deg)

# ---- group: Baked Numbering
baked_blue_line_in_sequence = Curve([<curve referenced from the Rhino model> x298])
baked_red_line_in_sequence = Curve([<curve referenced from the Rhino model> x267])
baked_orange_in_sequence = Curve([<curve referenced from the Rhino model> x209])
baked_yellow_in_sequence = Curve([<curve referenced from the Rhino model> x185])
baked_green_in_sequence = Curve([<curve referenced from the Rhino model> x181])
lng_5 = ListLength(List=baked_red_line_in_sequence)
addition_2 = Addition(A=lng_5, B=1)
pcen = PolygonCenter(Polyline=baked_red_line_in_sequence)  # -> CenterV, CenterE, CenterA
series = Series(Start=0, Step=1, Count=lng_5)
move_3 = Move(Geometry=pcen.CenterV, Motion=Vector(0, -0.6340440037, 0))  # -> Geometry, Transform
txt = Text("RD")
dup = DuplicateData(Data=txt, Number=lng_5, Order=True)
concat = Concatenate(FragmentA=dup, FragmentB=series)
tag = TextTag3D(Location=move_3.Geometry, Text=concat, Size=0.4, Justification=8)

# ---- group: Translate PnP Coords to Relative
vec2pt = Vector2Pt(PointA=pt, PointB=drec.BasePlane, Unitize=False)  # -> Vector, Length
rep = ReplaceText(Text=vec2pt.Vector, Find="{", RecursiveReplace=False)
rep_2 = ReplaceText(Text=rep, Find="}", RecursiveReplace=False)
split_2 = TextSplit(Text=rep_2, Separators=",")
split_3 = SplitList(List=split_2, Index=2)  # -> ListA, ListB
split_4 = SplitList(List=split_3.ListA, Index=1)  # -> flatten(ListA), flatten(ListB)

# ----
roundd = RoundToDecimalPlace(NumberX=deg, DecimalPlace=1, RoundType=1)  # -> flatten(Rounded), Difference

# ---- group: If rotation < 0 Flip to being positive
smaller = SmallerThan(FirstNumber=roundd.Rounded, SecondNumber=0)  # -> SmallerThan, OrEqualTo
dispatch_2 = Dispatch(List=roundd.Rounded, DispatchPattern=smaller.SmallerThan)  # -> ListA, ListB
addition_3 = Addition(A=dispatch_2.ListA, B=360)
weave = Weave(Pattern=smaller.SmallerThan, Stream0=dispatch_2.ListB, Stream1=addition_3, NullGaps=False)

# ----
number_slider = Slider(519, range=0..1000)
panel_7 = Panel(weave)

# ---- group: Create Numbered List
lng_6 = ListLength(List=weave)
series_2 = Series(Start=1, Step=1, Count=lng_6)
concat_2 = Concatenate(FragmentA="LED", FragmentB=series_2)

# ----
footprint_name = Text("SK6805-1515")
layer_name = Text("Front")
comment = Text("SK6805-1515 LED")
roundd_2 = RoundToDecimalPlace(NumberX=split_4.ListA, DecimalPlace=3, RoundType=0)  # -> Rounded, Difference
roundd_3 = RoundToDecimalPlace(NumberX=split_4.ListB, DecimalPlace=3, RoundType=0)  # -> Rounded, Difference
dup_2 = DuplicateData(Data=footprint_name, Number=lng_6, Order=True)
item_4 = ListItem(List=drec.BasePlane, Index=number_slider, Wrap=True)
dup_3 = DuplicateData(Data=layer_name, Number=lng_6, Order=True)
dup_4 = DuplicateData(Data=comment, Number=lng_6, Order=True)
item_5 = ListItem(List=concat_2, Index=number_slider, Wrap=True)
xy_2 = XYPlane(Origin=drec.BasePlane)

# ---- group: Add Rotation text info to each LED
move_4 = Move(Geometry=xy_2, Motion=Vector(0, -0.35636504, 0))  # -> Geometry, Transform
tag_2 = TextTag3D(Location=flatten(move_4.Geometry), Text=flatten(weave), Size=0.2, Justification=5)

# ----
path_mapper_22 = PathMapper(concat_2, source="{A;B}", target="{0}")
path_mapper_23 = PathMapper(dup_2, source="{A;B}", target="{1}")
path_mapper_24 = PathMapper(roundd_2.Rounded, source="{A}", target="{2}")
path_mapper_25 = PathMapper(roundd_3.Rounded, source="{A}", target="{3}")
path_mapper_26 = PathMapper(dup_3, source="{A;B}", target="{4}")
path_mapper_27 = PathMapper(weave, source="{A}", target="{5}")
path_mapper_28 = PathMapper(dup_4, source="{A;B}", target="{6}")
panel_8 = Panel("Designator")
panel_9 = Panel("Mid X")
panel_10 = Panel("Mid Y")
panel_11 = Panel("Layer")
panel_12 = Panel("Comment")
panel_13 = Panel("Package")
panel_14 = Panel("Rotation")

# ---- group: Bake to add labels to Dwgs.User
tag_3 = TextTag3D(Location=flatten(xy_2), Text=flatten(concat_2), Size=0.2, Justification=5)

# ----
headings = Text(["Designator", "Package", "Mid X", "Mid Y", "Layer", "Rotation", "Comment"])
csv = CreateCSV(
    DataGridHeaders=headings,
    ValueTree=[path_mapper_22, path_mapper_23, path_mapper_24, path_mapper_25, path_mapper_26, path_mapper_27, path_mapper_28],
    Delimiter=",",
    QuoteItems=False,
    DataStruct=False)
panel_15 = Panel(csv)

# ---- group: SVG export of filled shapes
white_silkscreen = Brep([<brep referenced from the Rhino model> x759])
front_mask = Curve([<curve referenced from the Rhino model> x5000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])
front_courtyard = Curve([<curve referenced from the Rhino model> x1704])
front_copper_combined = Curve([<curve referenced from the Rhino model> x2583])
front_paste_2 = Curve([<curve referenced from the Rhino model> x5000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])
edge_cuts = Curve(<curve referenced from the Rhino model>)
length_assuming_w_and_l_same = Line(Line((2.586913333, 4.120209028, 0), (502.5869133, 4.120209028, 0)))
solid_2 = SolidFill(ShapeGeometry=front_paste_2, Color=RGB(0, 0, 0))
solid_3 = SolidFill(ShapeGeometry=front_courtyard, Color=RGB(0, 0, 0))
solid_4 = SolidFill(ShapeGeometry=white_silkscreen, Color=RGB(0, 0, 0))
solid_5 = SolidFill(ShapeGeometry=[river_knockout_srfs, front_mask], Color=RGB(0, 0, 0))
solid_6 = SolidFill(ShapeGeometry=[front_copper_combined, river_knockout_srf], Color=RGB(0, 0, 0))
solid_7 = SolidFill(ShapeGeometry=edge_cuts, Color=RGB(0, 0, 0))
edge_cuts_bounding_box = Curve(<curve referenced from the Rhino model>)
len_2 = Length(Curve=length_assuming_w_and_l_same)
f_copper = ConstructDrawing(
    ShapesGeometry=solid_6,
    Boundary=edge_cuts_bounding_box,
    Width=len_2,
    Height=len_2,
    Color=RGBA(255, 255, 255, 0),
    Units=4)  # -> Drawing, Boundary
front_mask_2 = ConstructDrawing(
    ShapesGeometry=solid_5,
    Boundary=edge_cuts_bounding_box,
    Width=len_2,
    Height=len_2,
    Color=RGBA(255, 255, 255, 0),
    Units=4)  # -> Drawing, Boundary
front_solder_paste = ConstructDrawing(
    ShapesGeometry=solid_2,
    Boundary=edge_cuts_bounding_box,
    Width=len_2,
    Height=len_2,
    Color=RGBA(255, 255, 255, 0),
    Units=4)  # -> Drawing, Boundary
front_silks_2 = ConstructDrawing(
    ShapesGeometry=[solid_4, solid],
    Boundary=edge_cuts_bounding_box,
    Width=len_2,
    Height=len_2,
    Color=RGBA(255, 255, 255, 0),
    Units=4)  # -> Drawing, Boundary
front_courtyard_2 = ConstructDrawing(
    ShapesGeometry=solid_3,
    Boundary=edge_cuts_bounding_box,
    Width=len_2,
    Height=len_2,
    Color=RGBA(255, 255, 255, 0),
    Units=4)  # -> Drawing, Boundary
user_dwg = ConstructDrawing(Boundary=edge_cuts_bounding_box, Width=len_2, Height=len_2, Color=RGBA(255, 255, 255, 0), Units=4)  # -> Drawing, Boundary

# ----
stroke = Stroke(ShapeGeometry=edge_cuts, Color=RGB(0, 0, 0), Weight=1, EndCap=0)

# ---- group: SVG export of filled shapes (continued)
edge_cuts_2 = ConstructDrawing(ShapesGeometry=stroke, Boundary=edge_cuts_bounding_box, Width=len_2, Height=len_2, Color=RGBA(255, 255, 255, 0), Units=4)  # -> Drawing, Boundary

# ----
view = DrawingViewer(DrawingsShapesGeometry=front_solder_paste.Drawing, Resolution=96)
